# Grasshopper definition Multi-Data Recorder Final V1.gh (Grasshopper 1.0.7)

number_slider = Slider(1.09, range=1..20)
number_slider_2 = Slider(2.59, range=1..20)
number_slider_3 = Slider(12.39, range=1..20)
neg = Negative(Value=number_slider_2)
neg_2 = Negative(Value=number_slider)
galapagos = Galapagos(fitness=volume, gene=[number_slider_3, number_slider, number_slider_2])
dom = ConstructDomain(DomainStart=neg_2, DomainEnd=number_slider)
dom_2 = ConstructDomain(DomainStart=neg, DomainEnd=number_slider_2)
rectangle = Rectangle(Plane=PlaneXY(0, 0, 0), XSize=dom, YSize=dom_2, Radius=0)  # -> Rectangle, Length
boxrec = BoxRectangle(Rectangle=rectangle.Rectangle, Height=number_slider_3)
volume = Volume(Geometry=boxrec)  # -> Volume, Centroid
multi_data_recorder = CSharpScript(
    Variable1=number_slider,
    Variable2=number_slider_2,
    Variable3=number_slider_3,
    Variable4=volume.Volume,
    run=Toggle(True),
    reset=Toggle(False))  # -> out, List1, List2, List3, List4, List5; inputs Variable1: Double, Variable2: Double, Variable3: Double, Variable4: Double, Variable5: Double, run: Boolean, reset: Boolean
# ---------- multi_data_recorder: C# ----------
    if(run){
      a.Add(Variable1);
      b.Add(Variable2);
      c.Add(Variable3);
      d.Add(Variable4);
      e.Add(Variable5);
    }
    if(reset){
      a.Clear();
      b.Clear();
      c.Clear();
      d.Clear();
      e.Clear();
    }

    List<double> aa = new List<double>(a);
    aa.RemoveAt(0);
    List<double> bb = new List<double>(b);
    bb.RemoveAt(0);
    List<double> cc = new List<double>(c);
    cc.RemoveAt(0);
    List<double> dd = new List<double>(d);
    dd.RemoveAt(0);
    List<double> ee = new List<double>(e);
    ee.RemoveAt(0);

    List1 = aa;
    List2 = bb;
    List3 = cc;
    List4 = dd;
    List5 = ee;
# ---------- multi_data_recorder: C# additional code ----------
  List<double> a = new List<double>();
  List<double> b = new List<double>();
  List<double> c = new List<double>();
  List<double> d = new List<double>();
  List<double> e = new List<double>();
# ---------- end multi_data_recorder ----------
panel = Panel(multi_data_recorder.List2)
panel_2 = Panel(multi_data_recorder.List3)
panel_3 = Panel(multi_data_recorder.List1)
panel_4 = Panel(multi_data_recorder.List4)
panel_5 = Panel(volume.Volume)
preview = CustomPreview(
    Geometry=boxrec,
    Material={diffuse=RGB(222, 53, 222), emission=RGB(67, 16, 67), shine=0.5, specular=RGB(255, 255, 255), transparency=0})
export_to_csv = CSharpScript(
    List1=multi_data_recorder.List1,
    List2=multi_data_recorder.List2,
    List3=multi_data_recorder.List3,
    List4=multi_data_recorder.List4,
    List5=multi_data_recorder.List5,
    FileName="optimization_results",
    Headers="X,Y,Height,Volume",
    CSVFilePath="C:\Users\abdul\Desktop",
    ExportToCSV=Toggle(True))  # -> out; inputs List1: list of Double, List2: list of Double, List3: list of Double, List4: list of Double, List5: list of Double, FileName: String, Headers: String, CSVFilePath: String, ExportToCSV: Boolean
# ---------- export_to_csv: C# usings ----------
using System.Linq;
# ---------- export_to_csv: C# ----------
    // Exporting to CSV
    List<List<double>> lists = new List<List<double>>(){List1, List2, List3, List4, List5};

    string fileName = CSVFilePath + "\\" + FileName + ".CSV";
    var fileinfo = new System.IO.FileInfo(fileName);
    if(ExportToCSV){
      if(!fileinfo.Exists){
        fileinfo.Create();
      }
      var sw = fileinfo.CreateText();

      sw.WriteLine(Headers);

      sw.Flush();
      sw.Close();

      sw = fileinfo.AppendText();

      for (int i = 0; i < List1.Count; i++)
      {
        // Create a list to store values at the current index
        List<string> valuesToAdd = new List<string>();

        // Check each list for a value at the current index
        foreach (List<double> list in lists)
        {
          if (list.Count > i)
          {
            // Add the value to the list
            valuesToAdd.Add(list[i].ToString());
          }
          else
          {
            // Add a placeholder (e.g., an empty string) if the list has no value at the current index
            valuesToAdd.Add("");
          }
        }

        // Write the line only if at least one list has a value at the current index
        if (valuesToAdd.Any(value => !string.IsNullOrEmpty(value)))
        {
          sw.WriteLine(string.Join(",", valuesToAdd));
        }
      }
      sw.Flush();
      sw.Close();
      RhinoApp.WriteLine("Exported to : " + fileName);
    }

    Print("File successfully created at " + fileName + "!");
# ---------- end export_to_csv ----------
panel_6 = Panel(export_to_csv)
